# Grasshopper definition brooklyn_cnn_env.gh (Grasshopper 1.0.7)
# plug-ins: GH_CPython, DeCodingSpaces, HoopSnake, Pufferfish

# ---- group: Init_action
number_slider = Slider(770, range=0..1000)  # disabled
number_slider_2 = Slider(350, range=0..1000)  # disabled
number_slider_3 = Slider(1, range=0..10)  # disabled
merge = Merge(
    Data1=number_slider,
    Data2=number_slider_2,
    Data3=number_slider_3,
    Data4=number_slider_3,
    Data5=number_slider_3,
    Data6=number_slider_3)  # -> simplify(graft(Result)); disabled

# ----
path = DataPath("{0}")
path_2 = DataPath("{1}")
path_3 = DataPath("{2}")
path_4 = DataPath("{3}")
path_5 = DataPath("{4}")
path_6 = DataPath("{5}")
geo = Geometry([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])
geo_2 = Geometry([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])
preview = CustomPreview(Geometry=geo_2, Material=ColourSwatch(SwatchColor=RGB(105, 105, 105)))
preview_2 = CustomPreview(Geometry=geo, Material=ColourSwatch(SwatchColor=RGB(131, 186, 112)))
plots = Geometry(Tree({0}: [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], {1}: [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], {2}: [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], {3}: [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], {4}: [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], {5}: [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]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))  # disabled
streetblocks = Curve([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])  # disabled

# ---- group: RH_IN:z
num = Number(0)

# ----
buildable = BuildableArea(Parcels=plots, Blocks=streetblocks, RoadSetback=-7, SideSetback=-3, BackSetback=-3, Tolerance=0.785398)  # disabled
srf = Surface(Tree({0;0}: [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], {0;1}: [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], {1;0}: [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], {1;1}: [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], {1;2}: [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], {2;0}: [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]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))
building_max_height = Slider(200, range=0..1000)
number_slider_4 = Slider(-10, range=-10..-1)
Z = UnitZ(Factor=number_slider_4)
subtraction = Subtraction(A=building_max_height, B=number_slider_4)
Z_2 = UnitZ(Factor=subtraction)
move = Move(Geometry=srf, Motion=Z)  # -> Geometry, Transform
extr = Extrude(Base=move.Geometry, Direction=Z_2)
area = Area(Geometry=srf)  # -> Area, Centroid
crv = Curve([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])
Z_3 = UnitZ(Factor=Slider(-10, range=-10..-1))
boundary = BoundarySurfaces(Edges=crv)
move_2 = Move(Geometry=boundary, Motion=Z_3)  # -> Geometry, Transform
extr_2 = Extrude(Base=move_2.Geometry, Direction=Z_2)
Z_4 = UnitZ(Factor=0.01)
move_3 = Move(Geometry=srf, Motion=Z_4)  # -> Geometry, Transform

# ---- group: Building envelope area range
geo_3 = Geometry([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])  # disabled
debrep = DeconstructBrep(Brep=geo_3)  # -> Faces, Edges, Vertices; disabled
area_2 = Area(Geometry=debrep.Faces)  # -> Area, Centroid; disabled
number_slider_5 = Slider(10, range=0..30)  # disabled
ma = MassAddition(Input=area_2.Area)  # -> flatten(Result), PartialResults; disabled
lng = ListLength(List=ma.Result)  # -> expr("x - 1", Length); disabled
division = Division(A=number_slider_5, B=100)  # disabled
number_slider_6 = Slider(2, range=0..10)  # disabled
multiplication = Multiplication(A=lng, B=division)  # disabled
division_2 = Division(A=multiplication, B=number_slider_6)  # disabled
round = Round(Number=multiplication)  # -> Nearest, Floor, Ceiling; disabled
subtraction_2 = Subtraction(A=lng, B=division_2)  # disabled
dom = ConstructDomain(DomainStart=0, DomainEnd=round.Ceiling)  # disabled
round_2 = Round(Number=subtraction_2)  # -> Nearest, Floor, Ceiling; disabled
range = Range(Domain=dom, Steps=10)  # disabled
dom_2 = ConstructDomain(DomainStart=round_2.Floor, DomainEnd=lng)  # disabled
sort = SortList(Keys=ma.Result)  # -> Keys, ValuesA; disabled
range_2 = Range(Domain=dom_2, Steps=10)  # disabled
cull_i = CullIndex(List=sort.Keys, Indices=range_2, Wrap=True)  # disabled
cull_i_2 = CullIndex(List=cull_i, Indices=range, Wrap=True)  # disabled
bnd = Bounds(Numbers=cull_i_2)  # disabled
dedomain = DeconstructDomain(Domain=bnd)  # -> Start, End; disabled

# ----
preview_3 = CustomPreview(Geometry=move_3.Geometry, Material=ColourSwatch(SwatchColor=RGB(245, 239, 244)))
num_2 = Number(5000)
num_3 = Number(30000)

# ---- group: Observation
number_slider_7 = Slider(256, range=0..1000)

# ----
ma_2 = MassAddition(Input=flatten(area.Area))  # -> Result, PartialResults

# ---- group: Visualization
number_slider_8 = Slider(1080, range=0..1080)

# ----
hs = HoopSnake(
    StartingData=Toggle(False),
    Data=return_feedback,
    Hoopsnake_Data_autoUpdate=False,
    Hoopsnake_Data_dataLimit=2147483647,
    Hoopsnake_Data_resetCounter=True,
    Hoopsnake_Data_updateView=True)  # -> simplify(Feedback), FeedbackHistory, LoopsCounter, IterationsCounter
panel = Panel(hs.IterationsCounter)
rl_agent = RLAgent(done=hs.Feedback)  # -> done, ep_count, p1, p2, p3, p4, p5, p6; inputs done: list
# ---------- rl_agent: Python ----------
# -*- coding: utf-8 -*-
""" 
Python Script
Created on  Friday August 2021 07:49:42 
@author:  houssame e. hsain 

[desc]
A2C RL agent
[/desc]

ARGUMENTS:
----------
<inp> 
    state
</inp>

RETURN:
----------
<out>
    action
</out>
"""

from socket import socket, AF_INET, SOCK_STREAM

HOST = '127.0.0.1'
PORT1 = 8080
PORT2 = 8083

done_ = _done

# Receive Action
with socket(AF_INET, SOCK_STREAM) as s:
    s.connect((HOST, PORT1))
    action_byt = s.recv(5000)

action_out = action_byt.decode()

p1 = [float(item) for item in action_out.splitlines()[0].split()]
p2 = [float(item) for item in action_out.splitlines()[1].split()]
p3 = [float(item) for item in action_out.splitlines()[2].split()]
p4 = [float(item) for item in action_out.splitlines()[3].split()]
p5 = [float(item) for item in action_out.splitlines()[4].split()]
p6 = [float(item) for item in action_out.splitlines()[5].split()]

# Receive Episode count
with socket(AF_INET, SOCK_STREAM) as s:
    s.connect((HOST, PORT2))
    ep_count_byt = s.recv(5000)

ep_count = int(ep_count_byt.decode())
# ---------- end rl_agent ----------
panel_2 = Panel(rl_agent.done)
merge_2 = Merge(Data1=rl_agent.p1, Data2=rl_agent.p2, Data3=rl_agent.p3, Data4=rl_agent.p4, Data5=rl_agent.p5, Data6=rl_agent.p6)
lng_2 = ListLength(List=rl_agent.p1)
partition = PartitionList(List=merge_2, Size=lng_2)  # -> simplify(Chunks)
branch = TreeBranch(Tree=partition, Path=path, MaintainPaths=True)
branch_2 = TreeBranch(Tree=partition, Path=path_2, MaintainPaths=True)
branch_3 = TreeBranch(Tree=partition, Path=path_3, MaintainPaths=True)
branch_4 = TreeBranch(Tree=partition, Path=path_4, MaintainPaths=True)
branch_5 = TreeBranch(Tree=partition, Path=path_5, MaintainPaths=True)
branch_6 = TreeBranch(Tree=partition, Path=path_6, MaintainPaths=True)

# ---- group: RH_IN:theta
num_4 = Number(branch_3)
rad = Radians(Degrees=num_4)

# ---- group: RH_IN:x
num_5 = Number(branch)

# ---- group: RH_IN:y
num_6 = Number(branch_2)

# ---- group: RH_IN:length
num_7 = Number(branch_4)

# ---- group: RH_IN:width
num_8 = Number(branch_5)

# ---- group: RH_IN:height
num_9 = Number(branch_6)

# ----
pt = ConstructPoint(XCoordinate=num_5, YCoordinate=num_6, ZCoordinate=num)
rectangle = Rectangle(Plane=pt, XSize=num_7, YSize=num_8, Radius=0)  # -> Rectangle, Length
srf_2 = Surface(rectangle.Rectangle)
boxrec = BoxRectangle(Rectangle=rectangle.Rectangle, Height=num_9)
area_3 = Area(Geometry=srf_2)  # -> Area, Centroid
rotate = Rotate(Geometry=boxrec, Angle=rad, Plane=area_3.Centroid)  # -> Geometry, Transform

# ---- group: Last building mass
lastdex = LastIndex(List=rotate.Geometry)
item = ListItem(List=rotate.Geometry, Index=lastdex, Wrap=True)

# ----
debrep_2 = DeconstructBrep(Brep=item)  # -> Faces, Edges, Vertices
shapein = ShapeInBrep(Brep=flatten(extr), Shape=item)  # -> simplify(Relation)
shapein_2 = ShapeInBrep(Brep=rotate.Geometry, Shape=item)  # -> simplify(Relation)

# ---- group: boundary/building intersection
shapein_3 = ShapeInBrep(Brep=extr_2, Shape=item)  # -> simplify(Relation)

# ----
preview_3d_buildings = CustomPreview(Geometry=rotate.Geometry, Shader=ColourSwatch(SwatchColor=RGB(196, 175, 134)))
area_4 = Area(Geometry=debrep_2.Faces)  # -> Area, Centroid
ma_3 = MassAddition(Input=area_4.Area)  # -> flatten(Result), PartialResults
num_10 = Number(ma_3.Result)

# ---- group: Observation (continued)
captureview = LBCaptureView(
    viewport="Top",
    width=number_slider_7,
    height=number_slider_7,
    mode="Rendered",
    i=hs.IterationsCounter,
    capture=rotate.Geometry)  # -> observation; plug-in component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
panel_3 = Panel(captureview)

# ----
ma_4 = MassAddition(Input=flatten(area_3.Area))  # -> Result, PartialResults
division_3 = Division(A=ma_4.Result, B=ma_2.Result)
panel_4 = Panel(division_3)

python = GhPythonScript(
    boundary_relation=shapein_3,
    bArea_relation=shapein,
    bInter_relation=shapein_2,
    builtarea_ratio=division_3,
    env_area_start=num_2,
    env_area_end=num_3,
    gen_env_areas=num_10,
    bldg_bool=rotate.Geometry)  # -> reward, done; inputs boundary_relation: tree, bArea_relation: tree, bInter_relation: tree, gen_env_areas: list, bldg_bool: list
# ---------- python: Python ----------
"""Provides a scripting component.
    Inputs:
        bArea_relation: Relation between generated buildings masses and the boundary space.
        bInter_relation: Relation between generated building masses.
        avg_pct_comfort: Average over thermal comfort percentage values.
        builtarea_ratio: Sum of building footprint areas over buildable area.
    Output:
        reward: calculated reward."""

__author__ = "houssame eddine"
__version__ = "2021.08.13"

try:
    from ladybug_rhino.grasshopper import all_required_inputs
except ImportError as e:
    raise ImportError('\nFailed to import ladybug_rhino:\n\t{}'.format(e))

if all_required_inputs(ghenv.Component):
    reward = 0
    done = False
    
    boundary_relationList = [list(i) for i in boundary_relation.Branches]
    bArea_relationList = [list(i) for i in bArea_relation.Branches]
    bInter_relationList = [list(i) for i in bInter_relation.Branches]
    
    reward += 10
    for r in boundary_relationList:
        if r[0] != 0:
            reward -= 10
            # done = True

    for b in bArea_relationList:
        if 0 in b:
            reward += 2
        else:
            reward -= 5
            # done = True

    for i in bInter_relationList:
        for r in i:
            if r == 0:
                reward -= 2
            elif r == 1:
                reward -= 1
        reward += 1

    if builtarea_ratio >= 0.9:
        done = True

    for gen_area in gen_env_areas:
        if env_area_start < gen_area < env_area_end:
            reward += 1
        else:
            reward -= 1
    
    if len(bldg_bool) == 0:
        done = False
# ---------- end python ----------

# ---- group: RH_OUT:Done
bool = Boolean(python.done)

# ---- group: RH_OUT:Reward
int = Integer(python.reward)

# ---- group: Visualization (continued)
captureview_2 = LBCaptureView(
    viewport="Perspective",
    width=number_slider_8,
    height=number_slider_8,
    mode="Rendered",
    episode=rl_agent.ep_count,
    I=hs.IterationsCounter,
    reward=int,
    capture=rotate.Geometry)  # -> Visualization; plug-in component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
panel_5 = Panel(captureview_2)

# ----
return_feedback = Gh_client(fp=captureview, reward=int, done=bool)  # -> done; inputs reward: list, done: list
# ---------- return_feedback: Python ----------
# -*- coding: utf-8 -*-
""" 
Python Script

[desc]
Description of the plugin Here
Write here any thing... 
[/desc]

ARGUMENTS:
----------
<inp>
    done
</inp>
<inp> 
    reward
</inp>

RETURN:
----------
<out>
    done_out
</out>
"""
from socket import socket, AF_INET, SOCK_STREAM

HOST = '127.0.0.1'
PORT1 = 8084
PORT2 = 8081
PORT3 = 8082

done_ = done

# Encode GH input
fp_str = str(fp)
fp_byt = fp_str.encode()

# Send fp
with socket(AF_INET, SOCK_STREAM) as s:
    s.connect((HOST, PORT1))
    s.send(fp_byt)

# Send Reward
reward_str = str(reward)
reward_byt = reward_str.encode()

with socket(AF_INET, SOCK_STREAM) as s:
    s.connect((HOST, PORT2))
    s.send(reward_byt)

# Send done
done_str = str(done)
done_byt = done_str.encode()

with socket(AF_INET, SOCK_STREAM) as s:
    s.connect((HOST, PORT3))
    s.send(done_byt)
# ---------- end return_feedback ----------
filter = StreamFilter(Gate=return_feedback, Stream0=partition, Stream1=merge)  # disabled
