# Grasshopper definition brooklyn_env.gh (Grasshopper 1.0.7)
# plug-ins: DeCodingSpaces, HoopSnake, GH_CPython

# ---- group: Init_action
number_slider = Slider(0, range=0..100)
number_slider_2 = Slider(10, range=0..10)
merge = Merge(
    Data1=number_slider,
    Data2=number_slider,
    Data3=number_slider,
    Data4=number_slider_2,
    Data5=number_slider_2,
    Data6=number_slider_2)  # -> simplify(graft(Result))

# ----
geo = Geometry([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])
geo_2 = Geometry([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])
path = DataPath("{0}")
path_2 = DataPath("{1}")
path_3 = DataPath("{2}")
path_4 = DataPath("{3}")
path_5 = DataPath("{4}")
path_6 = DataPath("{5}")
preview = CustomPreview(Geometry=geo, Material=ColourSwatch(SwatchColor=RGB(105, 105, 105)))
preview_2 = CustomPreview(Geometry=geo_2, Material=ColourSwatch(SwatchColor=RGB(131, 186, 112)))
plots = Geometry(Tree({0}: [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], {1}: [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], {2}: [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], {3}: [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], {4}: [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], {5}: [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]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))
streetblocks = Curve([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])
buildable = BuildableArea(Parcels=plots, Blocks=streetblocks, RoadSetback=-7, SideSetback=-3, BackSetback=-3, Tolerance=0.785398)

# ---- group: RH_IN:z
int = Integer(0)

# ----
building_max_height = Slider(200, range=0..1000)
number_slider_3 = Slider(-10, range=-10..-1)
Z = UnitZ(Factor=number_slider_3)
subtraction = Subtraction(A=building_max_height, B=number_slider_3)
srf = Surface(buildable)
Z_2 = UnitZ(Factor=subtraction)
move = Move(Geometry=srf, Motion=Z)  # -> Geometry, Transform
extr = Extrude(Base=move.Geometry, Direction=Z_2)
area = Area(Geometry=srf)  # -> Area, Centroid
Z_3 = UnitZ(Factor=0.01)
move_2 = Move(Geometry=srf, Motion=Z_3)  # -> Geometry, Transform
preview_3 = CustomPreview(Geometry=move_2.Geometry, Material=ColourSwatch(SwatchColor=RGB(245, 239, 244)))
panel = Panel("https://www.energyplus.net/weather-download/north_and_central_america_wmo_region_4/USA/NY/USA_NY_New.York.City-Central.Park.94728_TMY/all")  # disabled
crv = Curve([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])
boundary = BoundarySurfaces(Edges=crv)
extr_2 = Extrude(Base=boundary, Direction=Z_2)
downloadepw = LBDownloadWeather(weather_URL=panel)  # -> epw_file, stat_file, ddy_file; disabled; plug-in component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
mesh_uv = MeshSurface(Surface=boundary, UCount=Slider(16, range=0..100), VCount=Slider(23, range=0..100), Overhang=True, Equalize=False)
geo_3 = Geometry([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])
demesh = DeconstructMesh(Mesh=mesh_uv)  # -> Vertices, Faces, Colours, Normals
txt = Text("C:\Users\zeina\ladybug_tools\resources\weather\USA_NY_New.York.City-Central.Park.94728_TMY\USA_NY_New.York.City-Central.Park.94728_TMY.epw")
importepw = LBImportEPW(epw_file=txt)  # -> location, dry_bulb_temperature, relative_humidity, wind_speed, direct_normal_rad, diffuse_horizontal_rad, horizontal_infrared_rad; plug-in component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
Z_4 = UnitZ(Factor=Slider(1.8, range=0..10))
analysisperiod = LBAnalysisPeriod(start_month=8, start_day=25, start_hour=10, end_month=8, end_day=28, end_hour=16)  # -> period, hoys, dates; plug-in component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
move_3 = Move(Geometry=demesh.Vertices, Motion=Z_4)  # -> Geometry, Transform
data = Data(importepw.relative_humidity)
data_2 = Data(importepw.wind_speed)
data_3 = Data(importepw.location)
data_4 = Data(importepw.dry_bulb_temperature)
data_5 = Data(importepw.direct_normal_rad)
data_6 = Data(importepw.diffuse_horizontal_rad)
data_7 = Data(importepw.horizontal_infrared_rad)
ln = Line(StartPoint=demesh.Vertices, EndPoint=move_3.Geometry)

# ---- group: RH_IN:SimOnOff
int_2 = Integer(Slider(1, range=0..1))

# ----
applyper = LBApplyAnalysisPeriod(data=data_4, period=analysisperiod.period)  # -> data; plug-in component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
applyper_2 = LBApplyAnalysisPeriod(data=data, period=analysisperiod.period)  # -> data; plug-in component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
applyper_3 = LBApplyAnalysisPeriod(data=data_2, period=analysisperiod.period)  # -> data; plug-in component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
applyper_4 = LBApplyAnalysisPeriod(data=data_5, period=analysisperiod.period)  # -> data; plug-in component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
applyper_5 = LBApplyAnalysisPeriod(data=data_6, period=analysisperiod.period)  # -> data; plug-in component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
applyper_6 = LBApplyAnalysisPeriod(data=data_7, period=analysisperiod.period)  # -> data; plug-in component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
bool = Boolean(int_2)

debrep = DeconstructBrep(Brep=geo_3)  # -> Faces, Edges, Vertices
area_2 = Area(Geometry=debrep.Faces)  # -> Area, Centroid
ma = MassAddition(Input=area_2.Area)  # -> flatten(Result), PartialResults
lng = ListLength(List=ma.Result)  # -> expr("x - 1", Length)
division = Division(A=Slider(10, range=0..30), B=100)
multiplication = Multiplication(A=lng, B=division)
division_2 = Division(A=multiplication, B=Slider(2, range=0..10))
round = Round(Number=multiplication)  # -> Nearest, Floor, Ceiling
subtraction_2 = Subtraction(A=lng, B=division_2)
dom = ConstructDomain(DomainStart=0, DomainEnd=round.Ceiling)
round_2 = Round(Number=subtraction_2)  # -> Nearest, Floor, Ceiling
range = Range(Domain=dom, Steps=10)
dom_2 = ConstructDomain(DomainStart=round_2.Floor, DomainEnd=lng)
sort = SortList(Keys=ma.Result)  # -> Keys, ValuesA
range_2 = Range(Domain=dom_2, Steps=10)
cull_i = CullIndex(List=sort.Keys, Indices=range_2, Wrap=True)
cull_i_2 = CullIndex(List=cull_i, Indices=range, Wrap=True)
bnd = Bounds(Numbers=cull_i_2)
dedomain = DeconstructDomain(Domain=bnd)  # -> Start, End

wires = BrepWireframe(Brep=[move_2.Geometry, geo, geo_2], Density=-1)  # -> flatten(Wireframe); disabled
number_slider_4 = Slider(11, range=0..23)  # disabled

# ---- group: Context
geo_4 = Geometry([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])  # disabled

# ----
ladybug = Ladybug_Ladybug()  # -> Vviiiiiiiiiizzz; disabled; plug-in component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
gradientlibrary = Ladybug_GradientLibrary(gradIndex=number_slider_4)  # -> customColors; disabled; plug-in component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
number_slider_5 = Slider(5, range=0..10)  # disabled
number_slider_6 = Slider(40, range=0..100)  # disabled
legendpar = LBLegendParameters(min=number_slider_5, max=number_slider_6, colors=gradientlibrary)  # -> leg_par; disabled; plug-in component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
number_slider_7 = Slider(256, range=0..1000)  # disabled
panel_2 = Panel("Top")  # disabled
panel_3 = Panel("Rendered")  # disabled
toggle = BooleanToggle(True)  # disabled
Z_5 = UnitZ(Factor=0.1)  # disabled
captureview = LBCaptureView(viewport=panel_2, width=number_slider_7, height=number_slider_7, mode=panel_3, capture=toggle)  # -> simplify(observation); disabled; plug-in component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
observation = Panel(captureview)  # disabled
join = TextJoin(Text=captureview, Join=" ")  # disabled
observation_2 = Panel(join)  # disabled

ma_2 = MassAddition(Input=flatten(area.Area))  # -> Result, PartialResults

a2c_rl_agent = A2CRLAgent(state=join_2)  # -> p1, p2, p3, p4, p5, p6; inputs state: list
# ---------- a2c_rl_agent: Python ----------
# -*- coding: utf-8 -*-
""" 
Python Script
Created on  Friday August 2021 07:49:42 
@author:  houssame e. hsain 

[desc]
A2C RL agent
[/desc]

ARGUMENTS:
----------
<inp> 
    state
</inp>

RETURN:
----------
<out>
    action
</out>
"""

from socket import socket, AF_INET, SOCK_STREAM

HOST = '127.0.0.1'
PORT = 8080

# Encode GH input
state_str = str(state)
state_byt = state_str.encode()

# Send State
with socket(AF_INET, SOCK_STREAM) as s:
    s.connect((HOST, PORT))
    s.send(state_byt)

# Receive Action
with socket(AF_INET, SOCK_STREAM) as s:
    s.connect((HOST, PORT))
    action_byt = s.recv(5000)

action_out = action_byt.decode()

p1 = [int(item) for item in action_out.splitlines()[0].split()]
p2 = [int(item) for item in action_out.splitlines()[1].split()]
p3 = [int(item) for item in action_out.splitlines()[2].split()]
p4 = [int(item) for item in action_out.splitlines()[3].split()]
p5 = [int(item) for item in action_out.splitlines()[4].split()]
p6 = [int(item) for item in action_out.splitlines()[5].split()]
# ---------- end a2c_rl_agent ----------
merge_2 = Merge(
    Data1=a2c_rl_agent.p1,
    Data2=a2c_rl_agent.p2,
    Data3=a2c_rl_agent.p3,
    Data4=a2c_rl_agent.p4,
    Data5=a2c_rl_agent.p5,
    Data6=a2c_rl_agent.p6)
lng_2 = ListLength(List=a2c_rl_agent.p1)
partition = PartitionList(List=merge_2, Size=lng_2)
hs = HoopSnake(
    StartingData=merge,
    Data=filter,
    Hoopsnake_Data_autoUpdate=False,
    Hoopsnake_Data_dataLimit=2147483647,
    Hoopsnake_Data_resetCounter=True,
    Hoopsnake_Data_updateView=True)  # -> simplify(Feedback), FeedbackHistory, LoopsCounter, IterationsCounter
panel_4 = Panel(hs.IterationsCounter)
branch = TreeBranch(Tree=hs.Feedback, Path=path, MaintainPaths=True)
branch_2 = TreeBranch(Tree=hs.Feedback, Path=path_2, MaintainPaths=True)
branch_3 = TreeBranch(Tree=hs.Feedback, Path=path_3, MaintainPaths=True)
branch_4 = TreeBranch(Tree=hs.Feedback, Path=path_4, MaintainPaths=True)
branch_5 = TreeBranch(Tree=hs.Feedback, Path=path_5, MaintainPaths=True)
branch_6 = TreeBranch(Tree=hs.Feedback, Path=path_6, MaintainPaths=True)

# ---- group: RH_IN:y
int_3 = Integer(branch_2)

# ---- group: RH_IN:theta
int_4 = Integer(branch_3)

# ---- group: RH_IN:length
int_5 = Integer(branch_4)

# ---- group: RH_IN:width
int_6 = Integer(branch_5)

# ---- group: RH_IN:height
int_7 = Integer(branch_6)

# ---- group: RH_IN:x
int_8 = Integer(branch)

# ----
pt = ConstructPoint(XCoordinate=int_8, YCoordinate=int_3, ZCoordinate=int)
rectangle = Rectangle(Plane=pt, XSize=int_5, YSize=int_6, Radius=0)  # -> Rectangle, Length
srf_2 = Surface(rectangle.Rectangle)
boxrec = BoxRectangle(Rectangle=rectangle.Rectangle, Height=int_7)
area_3 = Area(Geometry=srf_2)  # -> Area, Centroid
rotate = Rotate(Geometry=boxrec, Angle=int_4, Plane=area_3.Centroid)  # -> Geometry, Transform
debrep_2 = DeconstructBrep(Brep=rotate.Geometry)  # -> Faces, Edges, Vertices
wires_2 = BrepWireframe(Brep=rotate.Geometry, Density=-1)
shapein = ShapeInBrep(Brep=flatten(extr), Shape=graft(rotate.Geometry))  # -> simplify(Relation)
shapein_2 = ShapeInBrep(Brep=graft(rotate.Geometry), Shape=rotate.Geometry)  # -> simplify(Relation)
preview_3d_buildings = CustomPreview(Geometry=rotate.Geometry, Shader=ColourSwatch(SwatchColor=RGB(255, 255, 255)))
area_4 = Area(Geometry=debrep_2.Faces)  # -> Area, Centroid

# ---- group: boundary/building intersection
shapein_3 = ShapeInBrep(Brep=flatten(extr_2), Shape=graft(rotate.Geometry))  # -> simplify(Relation)

# ----
ma_3 = MassAddition(Input=area_4.Area)  # -> flatten(Result), PartialResults
num = Number(ma_3.Result)
brep = Brep(rotate.Geometry)
merge_3 = Merge(Data1=geo_3, Data2=brep)  # -> flatten(Result)
mesh = MeshBrep(
    Brep=merge_3,
    Settings={GridMaxCount=0, GridMinCount=16, JaggedSeams=False, MaxEdgeLength=0, MinEdgeLength=0.0001, MinTolerance=0, Refine=True, RefineAngle=0, RelativeTolerance=0.65, SimplePlanes=True, Tolerance=0})
mjoin = MeshJoin(Meshes=mesh)
humantosky = LBHumanToSkyRelation(
    h_points=demesh.Vertices,
    h_lines=ln,
    location=data_3,
    period=analysisperiod.period,
    hoys=analysisperiod.hoys,
    datetimes=analysisperiod.dates,
    context=flatten(mjoin),
    run=bool)  # -> fract_body_exp, sky_exposure; plug-in component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
outdoorsolarmrt = LBOutdoorSolarMRT(
    location=data_3,
    hoys=analysisperiod.hoys,
    surface_temp=applyper,
    dir_norm_rad=applyper_4,
    diff_horiz_rad=applyper_5,
    horiz_infrared=applyper_6,
    fract_body_exp=humantosky.fract_body_exp,
    sky_exposure=humantosky.sky_exposure,
    run=bool)  # -> report, mrt; plug-in component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
utci = LBUTCIComfort(air_temp=applyper, mrt=outdoorsolarmrt.mrt, rel_humid=applyper_2, wind_vel=applyper_3, run=bool)  # -> report, comf_obj; plug-in component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

comfstat = LBComfortStatistics(comf_obj=utci.comf_obj, run=bool)  # -> pct_comfortable; plug-in component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
avr = Average(Input=comfstat)

ma_4 = MassAddition(Input=flatten(area_3.Area))  # -> Result, PartialResults
division_3 = Division(A=ma_4.Result, B=ma_2.Result)
panel_5 = Panel(division_3)

# ---- group: Normalize
division_4 = Division(A=comfstat, B=Slider(100, range=0..100))

# ----
python = GhPythonScript(
    boundary_relation=shapein_3,
    bArea_relation=shapein,
    bInter_relation=shapein_2,
    avg_pct_comfort=avr,
    builtarea_ratio=division_3,
    env_area_start=dedomain.Start,
    env_area_end=dedomain.End,
    gen_env_areas=num,
    compute=bool)  # -> reward, done; inputs boundary_relation: tree, bArea_relation: tree, bInter_relation: tree, gen_env_areas: list
# ---------- python: Python ----------
"""Provides a scripting component.
    Inputs:
        bArea_relation: Relation between generated buildings masses and the boundary space.
        bInter_relation: Relation between generated building masses.
        avg_pct_comfort: Average over thermal comfort percentage values.
        builtarea_ratio: Sum of building footprint areas over buildable area.
    Output:
        reward: calculated reward."""

__author__ = "houssame eddine"
__version__ = "2021.08.13"

try:
    from ladybug_rhino.grasshopper import all_required_inputs
except ImportError as e:
    raise ImportError('\nFailed to import ladybug_rhino:\n\t{}'.format(e))

if _compute:
    if all_required_inputs(ghenv.Component):
        reward = 0
        
        boundary_relationList = [list(i) for i in boundary_relation.Branches]
        bArea_relationList = [list(i) for i in bArea_relation.Branches]
        bInter_relationList = [list(i) for i in bInter_relation.Branches]

        for r in boundary_relationList:
            if r != 0:
                reward -= 50
                # done = True

        for b in bArea_relationList:
            if 0 in b:
                reward += 5
            else:
                reward -= 10
                # done = True

        for i in bInter_relationList:
            for r in i:
                if r == 0:
                    reward -= 10
                elif r == 1:
                    reward -= 1
            reward += 1

        comfortcoeff = 5
        reward += comfortcoeff * int(avg_pct_comfort)

        ba_ratiocoeff = 100
        if builtarea_ratio < 1:
            reward += int(ba_ratiocoeff * builtarea_ratio)
        else:
            reward += int(ba_ratiocoeff * (2 - builtarea_ratio))
            done = True

        for gen_area in gen_env_areas:
            if env_area_start < gen_area < env_area_end:
                reward += 5
            else:
                reward -= 5

        if not done:
            done = False
# ---------- end python ----------

# ---- group: RH_OUT:Pct_comfort
num_2 = Number(simplify(division_4))

# ---- group: RH_OUT:Geo
geo_5 = Geometry(flatten([brep, geo_4, wires]))  # disabled

# ---- group: RH_OUT:Done
bool_2 = Boolean(python.done)

# ----
filter = StreamFilter(Gate=bool_2, Stream0=partition, Stream1=merge)  # -> simplify(Stream)

# ---- group: RH_OUT:Reward
int_9 = Integer(python.reward)

# ----
join_2 = TextJoin(Text=num_2, Join=" ")
reward = Gh_client(reward=int_9)  # inputs reward: list
# ---------- reward: Python ----------
# -*- coding: utf-8 -*-
""" 
Python Script

[desc]
Description of the plugin Here
Write here any thing... 
[/desc]

ARGUMENTS:
----------
<inp>
    done
</inp>
<inp> 
    reward
</inp>

RETURN:
----------
<out>
    done_out
</out>
"""

from socket import socket, AF_INET, SOCK_STREAM

HOST = '127.0.0.1'
PORT = 8081

# Encode GH input
reward_str = str(reward)
reward_byt = reward_str.encode()

# Send Reward
with socket(AF_INET, SOCK_STREAM) as s:
    s.connect((HOST, PORT))
    s.send(reward_byt)
# ---------- end reward ----------
done = Gh_client(done=bool_2)  # inputs done: list
# ---------- done: Python ----------
# -*- coding: utf-8 -*-
""" 
Python Script

[desc]
Description of the plugin Here
Write here any thing... 
[/desc]

ARGUMENTS:
----------
<inp>
    done
</inp>
<inp> 
    reward
</inp>

RETURN:
----------
<out>
    done_out
</out>
"""

from socket import socket, AF_INET, SOCK_STREAM

HOST = '127.0.0.1'
PORT = 8082

# Encode GH input
done_str = str(done)
done_byt = done_str.encode()

# Send Reward
with socket(AF_INET, SOCK_STREAM) as s:
    s.connect((HOST, PORT))
    s.send(done_byt)
# ---------- end done ----------
observation_3 = Panel(join_2)
heatmap = LBSpatialHeatmap(values=comfstat, mesh=mesh_uv, legend_par=legendpar)  # -> mesh, legend, title, colors, legend_par; disabled; plug-in component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
move_4 = Move(Geometry=heatmap.mesh, Motion=Z_5)  # -> Geometry, Transform; disabled
